# Grasshopper definition Unfolding_0.gh (Grasshopper 0.9.76)

demesh = DeconstructMesh()  # -> Vertices, Faces, Colours, Normals
mesh_to_unfold = Mesh(<mesh referenced from the Rhino model>)

number_slider = Slider(32, range=0..100)
int = Integer(number_slider)
item = ListItem(List=demesh.Vertices, Index=number_slider, Wrap=True)
boruvka_test = CSharpScript(stIdx=int)  # -> out, ctv, dst, lns, sp, tp; inputs ms: Mesh, stIdx: Int32
# ---------- boruvka_test: C# ----------
    DataTree<int> Connect = new DataTree<int>();
    DataTree<double> Distances = new DataTree<double>();

    MeshTree.Clear();
    visitedFaceInds.Clear();
    visitedInds.Clear();
    cutEdgeInds.Clear();
    lines.Clear();


    vertCount = ms.TopologyVertices.Count;
    m = ms;

    int startIdx = ms.TopologyVertices.TopologyVertexIndex(stIdx);
    preFaceIdx = 0;
    counter = 0;
    int newFaceIdx = ms.TopologyVertices.ConnectedFaces(startIdx)[0];


    // call recursive branching function (it continues to call itself)
    BranchOut(startIdx);

    // recursive function to lay flat faces
    SelectFace(newFaceIdx, new Point3f(0, 0, 0), new Point3f(0, 0, 0), new Point3f(0, 0, 0));

    sp = source_plane;
    tp = target_plane;
    ctv = cutEdgeInds;
    dst = MeshTree;
    lns = lines;
# ---------- boruvka_test: C# additional code ----------
  List<int> visitedInds = new List<int>();
  List<int> cutEdgeInds = new List<int>();
  List<Line> lines = new List<Line>();
  List<int> visitedFaceInds = new List<int>();
  int vertCount;
  int preFaceIdx;
  int counter;
  Plane source_plane;
  Plane target_plane;
  Mesh m;
  DataTree<Mesh> MeshTree = new DataTree<Mesh>();



  public void SelectFace(int i, Point3f ref_A, Point3f ref_B, Point3f ref_C){

    preFaceIdx = i;

    visitedFaceInds.Add(i);
    int[] GEFF = m.TopologyEdges.GetEdgesForFace(i);

    for (int j = 0; j < GEFF.Length; j++){
      int shared_edge = GEFF[j];
      if(cutEdgeInds.Contains(shared_edge) == false){
        int[] GCF = m.TopologyEdges.GetConnectedFaces(shared_edge);
        for(int k = 0; k < GCF.Length; k++){
          int curFaceIdx = GCF[k];
          if(visitedFaceInds.Contains(curFaceIdx) == false){

            if (counter < 50){
              GH_Path meshPath = new GH_Path(curFaceIdx);
              GH_Path flatPath = new GH_Path(preFaceIdx);

              double shared_length = m.TopologyEdges.EdgeLine(shared_edge).Length;
              IndexPair shared_verts = m.TopologyEdges.GetTopologyVertices(shared_edge);
              int[] face_verts = m.Faces.GetTopologicalVertices(curFaceIdx); // not sure about this

              Mesh mesh = new Mesh();

              if(counter == 0){
                // duplicate mesh face
                Point3d A = m.Vertices[m.Faces[curFaceIdx].A];
                Point3d B = m.Vertices[m.Faces[curFaceIdx].B];
                Point3d C = m.Vertices[m.Faces[curFaceIdx].C];

                mesh.Vertices.Add(A); //0
                mesh.Vertices.Add(B); //1
                mesh.Vertices.Add(C); //2

                mesh.Faces.AddFace(0, 1, 2);
                mesh.Normals.ComputeNormals();

                source_plane = new Plane(A, B, C);
                target_plane = Plane.WorldXY;
              }

              if (counter > 0){
                // 2. orient source plane x axis to shared edge
                for(int p = 0; p < face_verts.Length; p++){
                  if(face_verts[p] != shared_verts.I && face_verts[p] != shared_verts.J){
                    Print(face_verts[p].ToString());
                    source_C = m.Vertices[m.TopologyVertices.MeshVertexIndices(face_verts[p])[0]];
                  }
                }

                source_A = m.Vertices[m.TopologyVertices.MeshVertexIndices(shared_verts.I)[0]];
                source_B = m.Vertices[m.TopologyVertices.MeshVertexIndices(shared_verts.J)[0]];



                mesh.Vertices.Add(source_A); //0
                mesh.Vertices.Add(source_B); //1
                mesh.Vertices.Add(source_C); //2

                mesh.Faces.AddFace(0, 1, 2);
                mesh.Normals.ComputeNormals();

                //m.TopologyVertices.IndicesFromFace
                target_A = ref_A;
                target_B = ref_B;
                target_C = ref_C;

                Print(shared_verts.I.ToString());
                //Print(m.TopologyVertices.IndicesFromFace(i)[0];
                //Print(m.TopologyVertices[m.Faces[i].B].ToString());
                //Print(m.TopologyVertices[m.Faces[i].C].ToString());

                //what is the ordering of the previous face? need to create a mapping
                if (m.TopologyVertices.IndicesFromFace(i)[0] != shared_verts.I){
                  if (m.TopologyVertices.IndicesFromFace(i)[0] == shared_verts.J){
                    target_A = ref_B;
                    Print("A to B");
                  }
                  else{
                    target_A = ref_C;
                    Print("A to C");
                  }
                }

                if (m.TopologyVertices.IndicesFromFace(i)[1] != shared_verts.J){
                  if (m.TopologyVertices.IndicesFromFace(i)[1] == shared_verts.I){
                    target_B = ref_A;
                    Print("B to A");
                  }
                  else{
                    target_B = ref_C;
                    Print("B to C");
                  }
                }


                if (m.TopologyVertices.IndicesFromFace(i)[2] == shared_verts.I){
                  target_C = ref_A;
                  Print("C to A");
                }
                if (m.TopologyVertices.IndicesFromFace(i)[2] == shared_verts.J){
                  target_C = ref_B;
                  Print("C to B");
                }


                // 3. orient target plane x axis to shared edge


                // default order of 0 1 2 -- need to check for instances of 1 2 0
                target_plane = new Plane(target_A, target_B, target_C);
                target_plane.Rotate(Math.PI, new Vector3d(target_A - target_B));

                // see if the source plane's normal is consistent with Mesh normal.
                // if not, switch 0 and 1 and rebuild it
                MeshPoint facee = m.ClosestMeshPoint(source_A, 100);
                m.FaceNormals.ComputeFaceNormals();
                Vector3d meshNormal = m.FaceNormals[preFaceIdx];

                source_plane = new Plane(source_A, source_B, source_C);
                bool test = meshNormal.EpsilonEquals(source_plane.Normal, 1.0);

                if(test){
                  //Print("flipped plane");
                  //source_plane = new Plane(source_B, source_A, source_C);
                }
              }


              Transform xform = Transform.PlaneToPlane(source_plane, target_plane);
              mesh.Transform(xform);

              Point3f n_A = mesh.Vertices[mesh.Faces[0].A];
              Point3f n_B = mesh.Vertices[mesh.Faces[0].B];
              Point3f n_C = mesh.Vertices[mesh.Faces[0].C];

              MeshTree.Add(mesh, meshPath);
              counter++;
              SelectFace(curFaceIdx, n_A, n_B, n_C);
            }

          }
        }

      }
    }

  }



  public void BranchOut(int i){

    visitedInds.Add(i);

    double curDist = 0;
    double preDist = 1000000;
    int nextInd = 0;

    int[] curNeighbors = m.TopologyVertices.ConnectedTopologyVertices(i);

    for(int k = 0; k < curNeighbors.Length; k++){ // loop through each neighbor
      for(int j = 0; j < curNeighbors.Length; j++){ // loop through each neighbor
        bool[] naked = m.GetNakedEdgePointStatus();
        int[] curInd = m.TopologyVertices.MeshVertexIndices(curNeighbors[j]);

        if(visitedInds.Contains(curNeighbors[j]) == false && naked[curInd[0]] == false){

          int edgeIndex = m.TopologyEdges.GetEdgeIndex(i, curNeighbors[j]);
          Line l = m.TopologyEdges.EdgeLine(edgeIndex);

          curDist = l.Length;
          if (curDist < preDist){
            nextInd = curNeighbors[j];
            preDist = curDist;
          }

          // should directly in this for loop call recursive function

        }

      }

      if (nextInd > 0){

        int edgeInd = m.TopologyEdges.GetEdgeIndex(i, nextInd);
        cutEdgeInds.Add(edgeInd);

        Line ll = m.TopologyEdges.EdgeLine(edgeInd);
        lines.Add(ll);

        BranchOut(nextInd);
      }

    }
  }

  Point3f source_A;
  Point3f source_B;
  Point3f source_C;

  Point3f target_A;
  Point3f target_B;
  Point3f target_C;
# ---------- end boruvka_test ----------
medges = MeshEdges(Mesh=boruvka_test.dst)  # -> NakedEdges, InteriorEdges, NonManifoldEdges
line = Line(boruvka_test.lns)
preview = CustomPreview(Geometry=[medges.NakedEdges, medges.InteriorEdges], Shader=ColourSwatch(SwatchColor=RGB(64, 64, 64)))

# ----
# adjusting the start index means the tree
# branches out from different points - just
# guess and check which seems to work best
number_slider_2 = Slider(44, range=0..100)
# Depth first - causes more overlaps
unfold_1 = CSharpScript(ms=mesh_to_unfold, stIdx=number_slider_2)  # -> out, ctv, dst, lns; inputs ms: Mesh, stIdx: Int32
# ---------- unfold_1: C# ----------
    DataTree<int> Connect = new DataTree<int>();
    DataTree<double> Distances = new DataTree<double>();

    MeshTree.Clear();
    visitedFaceInds.Clear();
    visitedInds.Clear();
    cutEdgeInds.Clear();
    lines.Clear();


    vertCount = ms.TopologyVertices.Count;
    m = ms;

    int startIdx = ms.TopologyVertices.TopologyVertexIndex(stIdx);
    preFaceIdx = 0;
    counter = 0;
    int newFaceIdx = ms.TopologyVertices.ConnectedFaces(startIdx)[0];


    // call recursive branching function (it continues to call itself)
    Print(startIdx.ToString());
    BranchOut(startIdx);

    // lay flat face0
    Unfold(0, newFaceIdx, 0, ms);

    //visitedFaceInds.Add(newFaceIdx);

    // recursive function to lay flat faces
    SelectFace(newFaceIdx);


    ctv = cutEdgeInds;
    dst = MeshTree;
    lns = lines;
# ---------- unfold_1: C# additional code ----------
  List<int> visitedInds = new List<int>();
  List<int> cutEdgeInds = new List<int>();
  List<Line> lines = new List<Line>();
  List<int> visitedFaceInds = new List<int>();
  int vertCount;
  int preFaceIdx;
  int counter;
  Mesh m;
  DataTree<Mesh> MeshTree = new DataTree<Mesh>();


  public void Unfold(int preFaceIdx, int curFaceIdx, int shared_edge, Mesh ms){

    GH_Path meshPath = new GH_Path(curFaceIdx);
    GH_Path flatPath = new GH_Path(preFaceIdx);

    double shared_length = ms.TopologyEdges.EdgeLine(shared_edge).Length;
    IndexPair shared_verts = ms.TopologyEdges.GetTopologyVertices(shared_edge);
    int[] face_verts = ms.Faces.GetTopologicalVertices(curFaceIdx); // not sure about this

    // duplicate mesh face
    Point3d A = m.Vertices[m.Faces[curFaceIdx].A];
    Point3d B = m.Vertices[m.Faces[curFaceIdx].B];
    Point3d C = m.Vertices[m.Faces[curFaceIdx].C];

    Mesh mesh = new Mesh();
    mesh.Vertices.Add(A); //0
    mesh.Vertices.Add(B); //1
    mesh.Vertices.Add(C); //2

    mesh.Faces.AddFace(0, 1, 2);
    mesh.Normals.ComputeNormals();
    mesh.Compact();

    Plane source_plane = new Plane(A, B, C); // over-written for all except curFaceIdx=0
    Plane target_plane = Plane.WorldXY; // over-written for all except curfaceIdx=0

    if (counter > 0){
      // 2. orient source plane x axis to shared edge
      for(int p = 0; p < face_verts.Length; p++){
        if(face_verts[p] != shared_verts.I && face_verts[p] != shared_verts.J){
          source_C = ms.Vertices[ms.TopologyVertices.MeshVertexIndices(face_verts[p])[0]];
        }
      }

      source_A = ms.Vertices[ms.TopologyVertices.MeshVertexIndices(shared_verts.I)[0]];
      source_B = ms.Vertices[ms.TopologyVertices.MeshVertexIndices(shared_verts.J)[0]];

      // 3. orient target plane x axis to shared edge
      target_A = MeshTree[flatPath, 0].Vertices[0];
      target_B = MeshTree[flatPath, 0].Vertices[1];
      target_C = MeshTree[flatPath, 0].Vertices[2];

      double compare_AB = Math.Abs(1 - (target_A.DistanceTo(target_B) / shared_length));
      double compare_BC = Math.Abs(1 - (target_B.DistanceTo(target_C) / shared_length));
      double compare_CA = Math.Abs(1 - (target_C.DistanceTo(target_A) / shared_length));

      if(compare_BC < compare_AB && compare_BC < compare_CA){
        target_A = MeshTree[flatPath, 0].Vertices[1];
        target_B = MeshTree[flatPath, 0].Vertices[2];
        target_C = MeshTree[flatPath, 0].Vertices[0];
      }

      if(compare_CA < compare_BC && compare_CA < compare_AB){
        target_A = MeshTree[flatPath, 0].Vertices[2];
        target_B = MeshTree[flatPath, 0].Vertices[0];
        target_C = MeshTree[flatPath, 0].Vertices[1];
      }


      // default order of 0 1 2 -- need to check for instances of 1 2 0
      target_plane = new Plane(target_A, target_B, target_C);
      target_plane.Rotate(Math.PI, new Vector3d(target_A - target_B));

      source_plane = new Plane(source_A, source_B, source_C);

      // see if the source plane's normal is consistent with Mesh normal.
      // if not, switch 0 and 1 and rebuild it
      MeshPoint facee = ms.ClosestMeshPoint(source_A, 100);
      ms.FaceNormals.ComputeFaceNormals();
      Vector3d meshNormal = ms.FaceNormals[preFaceIdx];

      bool test = meshNormal.EpsilonEquals(source_plane.Normal, 1.0);
      if(test){
        source_plane = new Plane(source_B, source_A, source_C);
      }
    }

    Transform xform = Transform.PlaneToPlane(source_plane, target_plane);
    mesh.Transform(xform);

    MeshTree.Add(mesh, meshPath);
    counter++;

  }

  public void SelectFace(int i){

    preFaceIdx = i;

    visitedFaceInds.Add(i);
    int[] GEFF = m.TopologyEdges.GetEdgesForFace(i);

    for (int j = 0; j < GEFF.Length; j++){
      int shared_edge = GEFF[j];
      if(cutEdgeInds.Contains(shared_edge) == false){
        int[] GCF = m.TopologyEdges.GetConnectedFaces(shared_edge);
        for(int k = 0; k < GCF.Length; k++){
          int curFaceIdx = GCF[k];
          if(visitedFaceInds.Contains(curFaceIdx) == false){

            Unfold(i, curFaceIdx, shared_edge, m);

            SelectFace(curFaceIdx);
          }
        }

      }
    }

  }



  public void BranchOut(int i){

    visitedInds.Add(i);

    double curDist = 0;
    double preDist = 1000000;
    int nextInd = 0;

    int[] curNeighbors = m.TopologyVertices.ConnectedTopologyVertices(i);

    for(int k = 0; k < curNeighbors.Length; k++){ // loop through each neighbor
      for(int j = 0; j < curNeighbors.Length; j++){ // loop through each neighbor
        bool[] naked = m.GetNakedEdgePointStatus();
        int[] curInd = m.TopologyVertices.MeshVertexIndices(curNeighbors[j]);

        if(visitedInds.Contains(curNeighbors[j]) == false && naked[curInd[0]] == false){

          int edgeIndex = m.TopologyEdges.GetEdgeIndex(i, curNeighbors[j]);
          Line l = m.TopologyEdges.EdgeLine(edgeIndex);

          curDist = l.Length;
          if (curDist < preDist){
            nextInd = curNeighbors[j];
            preDist = curDist;
          }

          // should directly in this for loop call recursive function

        }

      }

      if (nextInd > 0){

        int edgeInd = m.TopologyEdges.GetEdgeIndex(i, nextInd);
        cutEdgeInds.Add(edgeInd);

        Line ll = m.TopologyEdges.EdgeLine(edgeInd);
        lines.Add(ll);

        // Unroll here instead
        BranchOut(nextInd);
      }

    }
  }

  Point3f source_A;
  Point3f source_B;
  Point3f source_C;

  Point3f target_A;
  Point3f target_B;
  Point3f target_C;
# ---------- end unfold_1 ----------
# Breadth first - usually works better
unfold_2 = CSharpScript(ms=mesh_to_unfold, stIdx=Slider(44, range=0..100))  # -> out, ctv, dst, lns; inputs ms: Mesh, stIdx: Int32
# ---------- unfold_2: C# ----------
    DataTree<int> Connect = new DataTree<int>();
    DataTree<double> Distances = new DataTree<double>();

    MeshTree.Clear();
    visitedFaceInds.Clear();
    visitedInds.Clear();
    cutEdgeInds.Clear();
    lines.Clear();


    vertCount = ms.TopologyVertices.Count;
    m = ms;

    List<int> startIdx = new List<int>();

    startIdx.Add(ms.TopologyVertices.TopologyVertexIndex(stIdx));
    preFaceIdx = 0;
    counter = 0;
    int newFaceIdx = 0;//ms.TopologyVertices.ConnectedFaces(startIdx)[0];
    depth = 0;

    // call recursive branching function (it continues to call itself)
    //Print(startIdx.ToString());
    BranchOut(startIdx);

    // lay flat face0
    Unfold(0, newFaceIdx, 0, ms);

    //visitedFaceInds.Add(newFaceIdx);

    // recursive function to lay flat faces
    SelectFace(newFaceIdx);


    ctv = cutEdgeInds;
    dst = MeshTree;
    lns = lines;
# ---------- unfold_2: C# additional code ----------
  List<int> visitedInds = new List<int>();
  List<int> cutEdgeInds = new List<int>();
  List<Line> lines = new List<Line>();
  List<int> visitedFaceInds = new List<int>();
  int vertCount;
  int preFaceIdx;
  int counter;
  Mesh m;
  DataTree<Mesh> MeshTree = new DataTree<Mesh>();
  int depth;


  public void Unfold(int preFaceIdx, int curFaceIdx, int shared_edge, Mesh ms){

    GH_Path meshPath = new GH_Path(curFaceIdx);
    GH_Path flatPath = new GH_Path(preFaceIdx);

    double shared_length = ms.TopologyEdges.EdgeLine(shared_edge).Length;
    IndexPair shared_verts = ms.TopologyEdges.GetTopologyVertices(shared_edge);
    int[] face_verts = ms.Faces.GetTopologicalVertices(curFaceIdx); // not sure about this

    // duplicate mesh face
    Point3d A = m.Vertices[m.Faces[curFaceIdx].A];
    Point3d B = m.Vertices[m.Faces[curFaceIdx].B];
    Point3d C = m.Vertices[m.Faces[curFaceIdx].C];

    Mesh mesh = new Mesh();
    mesh.Vertices.Add(A); //0
    mesh.Vertices.Add(B); //1
    mesh.Vertices.Add(C); //2

    mesh.Faces.AddFace(0, 1, 2);
    mesh.Normals.ComputeNormals();
    mesh.Compact();

    Plane source_plane = new Plane(A, B, C); // over-written for all except curFaceIdx=0
    Plane target_plane = Plane.WorldXY; // over-written for all except curfaceIdx=0


    if (counter > 0){
      // 2. orient source plane x axis to shared edge
      for(int p = 0; p < face_verts.Length; p++){
        if(face_verts[p] != shared_verts.I && face_verts[p] != shared_verts.J){
          source_C = ms.Vertices[ms.TopologyVertices.MeshVertexIndices(face_verts[p])[0]];
        }
      }


      source_A = ms.Vertices[ms.TopologyVertices.MeshVertexIndices(shared_verts.I)[0]];
      source_B = ms.Vertices[ms.TopologyVertices.MeshVertexIndices(shared_verts.J)[0]];


      // 3. orient target plane x axis to shared edge
      target_A = MeshTree[flatPath, 0].Vertices[0];
      target_B = MeshTree[flatPath, 0].Vertices[1];
      target_C = MeshTree[flatPath, 0].Vertices[2];

      double compare_AB = Math.Abs(1 - (target_A.DistanceTo(target_B) / shared_length));
      double compare_BC = Math.Abs(1 - (target_B.DistanceTo(target_C) / shared_length));
      double compare_CA = Math.Abs(1 - (target_C.DistanceTo(target_A) / shared_length));

      if(compare_BC < compare_AB && compare_BC < compare_CA){
        target_A = MeshTree[flatPath, 0].Vertices[1];
        target_B = MeshTree[flatPath, 0].Vertices[2];
        target_C = MeshTree[flatPath, 0].Vertices[0];
      }

      if(compare_CA < compare_BC && compare_CA < compare_AB){
        target_A = MeshTree[flatPath, 0].Vertices[2];
        target_B = MeshTree[flatPath, 0].Vertices[0];
        target_C = MeshTree[flatPath, 0].Vertices[1];
      }


      // default order of 0 1 2 -- need to check for instances of 1 2 0
      target_plane = new Plane(target_A, target_B, target_C);
      target_plane.Rotate(Math.PI, new Vector3d(target_A - target_B));

      source_plane = new Plane(source_A, source_B, source_C);

      // see if the source plane's normal is consistent with Mesh normal.
      // if not, switch 0 and 1 and rebuild it
      MeshPoint facee = ms.ClosestMeshPoint(source_A, 100);
      ms.FaceNormals.ComputeFaceNormals();
      Vector3d meshNormal = ms.FaceNormals[preFaceIdx];

      bool test = meshNormal.EpsilonEquals(source_plane.Normal, 1.0);
      if(test){
        source_plane = new Plane(source_B, source_A, source_C);
      }
    }

    Transform xform = Transform.PlaneToPlane(source_plane, target_plane);
    mesh.Transform(xform);

    MeshTree.Add(mesh, meshPath);
    counter++;


  }

  public void SelectFace(int i){

    preFaceIdx = i;

    visitedFaceInds.Add(i);
    int[] GEFF = m.TopologyEdges.GetEdgesForFace(i);

    for (int j = 0; j < GEFF.Length; j++){
      int shared_edge = GEFF[j];
      if(cutEdgeInds.Contains(shared_edge) == false){
        int[] GCF = m.TopologyEdges.GetConnectedFaces(shared_edge);
        for(int k = 0; k < GCF.Length; k++){
          int curFaceIdx = GCF[k];
          if(visitedFaceInds.Contains(curFaceIdx) == false){

            Unfold(i, curFaceIdx, shared_edge, m);

            SelectFace(curFaceIdx);
          }
        }

      }
    }

  }




  public void BranchOut(List<int> curList){

    List <int> nextInd = new List<int>();

    for(int k = 0; k < curList.Count; k++){ // loop through each current

      int[] curNeighbors = m.TopologyVertices.ConnectedTopologyVertices(curList[k]);

      for(int j = 0; j < curNeighbors.Length; j++){ // loop through each neighbor

        bool[] naked = m.GetNakedEdgePointStatus();
        int[] curInd = m.TopologyVertices.MeshVertexIndices(curNeighbors[j]);

        if(visitedInds.Contains(curNeighbors[j]) == false && naked[curInd[0]] == false){

          int edgeIndex = m.TopologyEdges.GetEdgeIndex(curList[k], curNeighbors[j]);
          Line l = m.TopologyEdges.EdgeLine(edgeIndex);
          lines.Add(l);

          cutEdgeInds.Add(edgeIndex);

          nextInd.Add(curNeighbors[j]);

          visitedInds.Add(curNeighbors[j]);

        }

      }


    }

    depth++;
    if(depth < 8){
      BranchOut(nextInd);
    }

  }

  Point3f source_A;
  Point3f source_B;
  Point3f source_C;

  Point3f target_A;
  Point3f target_B;
  Point3f target_C;
# ---------- end unfold_2 ----------
boruvka_test_2 = CSharpScript(stIdx=int)  # -> out, ctv, dst, lns, sp, tp; inputs ms: Mesh, stIdx: Int32
# ---------- boruvka_test_2: C# ----------
    DataTree<int> Connect = new DataTree<int>();
    DataTree<double> Distances = new DataTree<double>();

    MeshTree.Clear();
    visitedFaceInds.Clear();
    visitedInds.Clear();
    cutEdgeInds.Clear();
    lines.Clear();


    vertCount = ms.TopologyVertices.Count;
    m = ms;

    int startIdx = ms.TopologyVertices.TopologyVertexIndex(stIdx);
    preFaceIdx = 0;
    counter = 0;
    int newFaceIdx = ms.TopologyVertices.ConnectedFaces(startIdx)[0];


    // call recursive branching function (it continues to call itself)
    BranchOut(startIdx);

    // lay flat first face
    Unfold(0, newFaceIdx, 0, ms);

    // recursive function to lay flat faces
    SelectFace(newFaceIdx);

    sp = source_plane;
    tp = target_plane;
    ctv = cutEdgeInds;
    dst = MeshTree;
    lns = lines;
# ---------- boruvka_test_2: C# additional code ----------
  List<int> visitedInds = new List<int>();
  List<int> cutEdgeInds = new List<int>();
  List<Line> lines = new List<Line>();
  List<int> visitedFaceInds = new List<int>();
  int vertCount;
  int preFaceIdx;
  int counter;
  Plane source_plane;
  Plane target_plane;
  Mesh m;
  DataTree<Mesh> MeshTree = new DataTree<Mesh>();


  public void Unfold(int preFaceIdx, int curFaceIdx, int shared_edge, Mesh ms){

    GH_Path meshPath = new GH_Path(curFaceIdx);
    GH_Path flatPath = new GH_Path(preFaceIdx);

    double shared_length = ms.TopologyEdges.EdgeLine(shared_edge).Length;
    IndexPair shared_verts = ms.TopologyEdges.GetTopologyVertices(shared_edge);
    int[] face_verts = ms.Faces.GetTopologicalVertices(curFaceIdx); // not sure about this

    // duplicate mesh face
    Point3d A = m.Vertices[m.Faces[curFaceIdx].A];
    Point3d B = m.Vertices[m.Faces[curFaceIdx].B];
    Point3d C = m.Vertices[m.Faces[curFaceIdx].C];

    Mesh mesh = new Mesh();
    mesh.Vertices.Add(A); //0
    mesh.Vertices.Add(B); //1
    mesh.Vertices.Add(C); //2

    mesh.Faces.AddFace(0, 1, 2);
    mesh.Normals.ComputeNormals();
    mesh.Compact();

    source_plane = new Plane(A, B, C); // over-written for all except curFaceIdx=0
    target_plane = Plane.WorldXY; // over-written for all except curfaceIdx=0

    if (counter > 0){
      // 2. orient source plane x axis to shared edge
      for(int p = 0; p < face_verts.Length; p++){
        if(face_verts[p] != shared_verts.I && face_verts[p] != shared_verts.J){
          Print(face_verts[p].ToString());
          source_C = ms.Vertices[ms.TopologyVertices.MeshVertexIndices(face_verts[p])[0]];
        }
      }

      source_A = ms.Vertices[ms.TopologyVertices.MeshVertexIndices(shared_verts.I)[0]];
      source_B = ms.Vertices[ms.TopologyVertices.MeshVertexIndices(shared_verts.J)[0]];

      // 3. orient target plane x axis to shared edge
      target_A = MeshTree[flatPath, 0].Vertices[0];
      target_B = MeshTree[flatPath, 0].Vertices[1];
      target_C = MeshTree[flatPath, 0].Vertices[2];

      //IndexPair sharedVerts = m.TopologyEdges.GetTopologyVertices(shared_edge);
      Print("I: " + shared_verts.I.ToString());
      Print("J: " + shared_verts.J.ToString());
      // get topology vertices in order for each face
      int[] preVerts = m.TopologyVertices.IndicesFromFace(preFaceIdx);
      int[] curVerts = m.TopologyVertices.IndicesFromFace(curFaceIdx);

      Print("pre: " + preVerts[0].ToString() + " cur: " + curVerts[0].ToString());
      Print("pre: " + preVerts[1].ToString() + " cur: " + curVerts[1].ToString());
      Print("pre: " + preVerts[2].ToString() + " cur: " + curVerts[2].ToString());

      /*if(curVerts[0] != shared_verts.I && curVerts[0] != shared_verts.J){
        target_A = MeshTree[flatPath, 0].Vertices[2];
        Print("A to C");
      }

      if(curVerts[0] == shared_verts.J){
        target_A = MeshTree[flatPath, 0].Vertices[1];
        Print("A to B");
      }

      if(curVerts[1] != shared_verts.I && curVerts[1] != shared_verts.J){
        target_B = MeshTree[flatPath, 0].Vertices[2];
        Print("B to C");
      }

      if(curVerts[1] == shared_verts.I){
        target_B = MeshTree[flatPath, 0].Vertices[0];
        Print("B to A");
      }

      if(curVerts[2] == shared_verts.J){
        target_C = MeshTree[flatPath, 0].Vertices[1];
        Print("C to B");
      }

      if(curVerts[2] == shared_verts.I){
        target_C = MeshTree[flatPath, 0].Vertices[0];
        Print("C to A");
      }*/

      // default order of 0 1 2 -- need to check for instances of 1 2 0
      target_plane = new Plane(target_A, target_B, target_C);
      target_plane.Rotate(Math.PI, new Vector3d(target_A - target_B));

      source_plane = new Plane(source_A, source_B, source_C);

      // see if the source plane's normal is consistent with Mesh normal.
      // if not, switch 0 and 1 and rebuild it
      MeshPoint facee = ms.ClosestMeshPoint(source_A, 100);
      ms.FaceNormals.ComputeFaceNormals();
      Vector3d meshNormal = ms.FaceNormals[preFaceIdx];

      bool test = meshNormal.EpsilonEquals(source_plane.Normal, 1.0);
      if(test){
        Print("flipped plane");
        source_plane = new Plane(source_B, source_A, source_C);
      }
    }

    Transform xform = Transform.PlaneToPlane(source_plane, target_plane);
    mesh.Transform(xform);

    MeshTree.Add(mesh, meshPath);
    counter++;

  }

  public void SelectFace(int i){

    preFaceIdx = i;

    visitedFaceInds.Add(i);
    int[] GEFF = m.TopologyEdges.GetEdgesForFace(i);

    for (int j = 0; j < GEFF.Length; j++){
      int shared_edge = GEFF[j];
      if(cutEdgeInds.Contains(shared_edge) == false){
        int[] GCF = m.TopologyEdges.GetConnectedFaces(shared_edge);
        for(int k = 0; k < GCF.Length; k++){
          int curFaceIdx = GCF[k];
          if(visitedFaceInds.Contains(curFaceIdx) == false){

            if (counter < 3)
            Unfold(i, curFaceIdx, shared_edge, m);

            SelectFace(curFaceIdx);
          }
        }

      }
    }

  }



  public void BranchOut(int i){

    visitedInds.Add(i);

    double curDist = 0;
    double preDist = 1000000;
    int nextInd = 0;

    int[] curNeighbors = m.TopologyVertices.ConnectedTopologyVertices(i);

    for(int k = 0; k < curNeighbors.Length; k++){ // loop through each neighbor
      for(int j = 0; j < curNeighbors.Length; j++){ // loop through each neighbor
        bool[] naked = m.GetNakedEdgePointStatus();
        int[] curInd = m.TopologyVertices.MeshVertexIndices(curNeighbors[j]);

        if(visitedInds.Contains(curNeighbors[j]) == false && naked[curInd[0]] == false){

          int edgeIndex = m.TopologyEdges.GetEdgeIndex(i, curNeighbors[j]);
          Line l = m.TopologyEdges.EdgeLine(edgeIndex);

          curDist = l.Length;
          if (curDist < preDist){
            nextInd = curNeighbors[j];
            preDist = curDist;
          }

          // should directly in this for loop call recursive function

        }

      }

      if (nextInd > 0){

        int edgeInd = m.TopologyEdges.GetEdgeIndex(i, nextInd);
        cutEdgeInds.Add(edgeInd);

        Line ll = m.TopologyEdges.EdgeLine(edgeInd);
        lines.Add(ll);

        // Unroll here instead
        BranchOut(nextInd);
      }

    }
  }

  Point3f source_A;
  Point3f source_B;
  Point3f source_C;

  Point3f target_A;
  Point3f target_B;
  Point3f target_C;
# ---------- end boruvka_test_2 ----------
mesh = Mesh(unfold_1.dst)
mesh_2 = Mesh(unfold_2.dst)
line_2 = Line(unfold_2.lns)
line_3 = Line(unfold_1.lns)
medges_2 = MeshEdges(Mesh=mesh_2)  # -> NakedEdges, InteriorEdges, NonManifoldEdges
medges_3 = MeshEdges(Mesh=mesh)  # -> NakedEdges, InteriorEdges, NonManifoldEdges
panel = Panel(boruvka_test.out)
sort = SortList()  # -> Keys, ValuesA
